# Grasshopper definition trainer.gh (Grasshopper 1.0.7)
# plug-ins: gHowl, jSwan, Sasquatch, Karamba3D, NGon, Chimera, Heteroptera, Telepathy

panel = Panel("F:\Engine_Projects\BowerML\Unity\BowerTrainer\Assets\Exported\Results")
next = Button()
reset = Button()
export = Button()
search = FileSearch(Directory=panel, Pattern="*.json", Subfolder=False)
panel_2 = Panel(search)
lng = ListLength(List=panel_2)
c_script = CSharpScript(run=next, reset=Button(), max=lng)  # -> A; inputs run: Boolean, reset: Boolean, max: Int32
# ---------- c_script: C# ----------
    if (run && count <= max){
      count++;
    }
    else if (reset){
      count = 0;
    }
    A = count;
# ---------- c_script: C# additional code ----------
  int count = 0;
# ---------- end c_script ----------
panel_3 = Panel(c_script)
panel_4 = Panel("C:\Users\Sean\OneDrive\Project\Mongorel Assembly\final_sem\result\module\auto")
number_slider = Slider(2, range=0..100)
interval = Slider(100, range=50..15000)
number_slider_2 = Slider(4, range=0..10)
item = ListItem(List=panel_2, Index=panel_3, Wrap=True)
depath = DeconstructPath(Path=item)  # -> Directory, Filename, FileExtension
panel_5 = Panel(depath.Filename)
number_slider_3 = Slider(0, range=0..5)
panel_6 = Panel("0.22359,4.994917,-0.028456,84.97282,360,0")
python = GhPythonScript(x=item)  # -> a
# ---------- python: Python ----------
import rhinoscriptsyntax as rs
import json

def read_json(path):
    with open(path, 'r') as file:
        data = json.load(file)
        return data

def replace_last(s, new_value):
    # Split the string, convert to integers, change the last item, and convert back to string
    new_s = ','.join(map(str, list(map(int, s.split(',')))[:-1] + [new_value]))
    return new_s

json = read_json(x)

result = json["serializedData"]
result = result[:-1]
#result.append(replace_last(result[-1], "2"))
#result.append("0,0,0,0,0,1")
a = result
# ---------- end python ----------
lng_2 = ListLength(List=python)
counter = MK_Counter(Run=Toggle(False), StartNumber=0, TargetNumber=lng_2, Interval=interval)
# OnEpisodeBegin()
# {
#     reset = 1
# }
# OnActionReceived()
# {
#     reset = 0
# }
panel_7 = Panel(".3dm")
path = CreatePath(Directory=panel_4, Filename=depath.Filename, Extension=panel_7, Mode="any")
# input
# - rot float x, y, z
# - spawn int x (float x, y, z) # end point
# - finished bool
# 
# action
# 1. search spawn
# 2. Spawn (discrete)
# 3. rotate
#     - Continuous
#     - Discrete (0, 45, 90, 135, 180, 225, 270, 315)
# 
# observation
# 1. local observation
#     - spawn candidates{
#         // relative position to current endpt
#         step 1 = [x1, y1, z1, 0, 0, 0, 0, 0, 0]
#         step 2 = [x2, y2, z2, x1, y1, z1, 0, 0, 0] // limit to 3 pts
#     }
# 2. global observation
#     - center of mass
#     - bounding box dim
#     - density
#     ...
panel_8 = Panel(python)
udp = UDPReceiver(Port=6002, Pattern=0)  # -> Info, Data
panel_9 = Panel(counter)
panel_10 = Panel(path)
item_2 = ListItem(List=python, Index=panel_9, Wrap=True)
panel_11 = Panel(udp.Data)
raw_in = RemoteSender(udp.Data)
panel_12 = Panel(item_2)
extract_msg = GhPythonScript(x=udp.Data)  # -> loc_x, loc_y, loc_z, rot_x, rot_y, reset, export
# ---------- extract_msg: Python ----------
import rhinoscriptsyntax as rs
import Grasshopper as gh
if not x:
    reset = False
    msg = "No incomming data"
    ghenv.Component.AddRuntimeMessage(gh.Kernel.GH_RuntimeMessageLevel.Warning, msg)
else:
    splited = x.split(",")
    loc_x = splited[0]
    loc_y = splited[1]
    loc_z = splited[2]
    rot_x = splited[3]
    rot_y = splited[4]
    if splited[-1] == "0":
        reset = False
        export = False
    elif splited[-1] == "1":
        reset = True
    elif splited[-1] == "2":
        reset = False
        export = True
    else:
        reset = False
        export = False
        msg = "Unexpected reset key \"" + splited[-1] + "\""
        ghenv.Component.AddRuntimeMessage(gh.Kernel.GH_RuntimeMessageLevel.Error, msg)
# ---------- end extract_msg ----------

# ---- group: Line
ln = Line(StartPoint="0,0,0", EndPoint="0,0,5")

# ----
pt = ConstructPoint(XCoordinate=extract_msg.loc_x, YCoordinate=extract_msg.loc_y, ZCoordinate=extract_msg.loc_z)
origin = Origin()
pt_2 = ConstructPoint(XCoordinate=extract_msg.rot_x, YCoordinate=extract_msg.rot_y, ZCoordinate=0)
spawn = RemoteSender(pt)
vec2pt = Vector2Pt(PointA=origin, PointB=pt, Unitize=False)  # -> Vector, Length
pipeline = GeometryPipeline(
    GroupByLayer=False,
    GroupByType=False,
    IncludeHidden=True,
    IncludeLocked=True,
    LayerFilter="line",
    NameFilter="*",
    SublayerFiltering=True,
    TypeFilter=4)
unityaction = CSharpScript(spawn=spawn, rotation=pt_2)  # -> A; inputs spawn: Point3d, rotation: Point3d
# ---------- unityaction: C# ----------
    // Convert angles from degrees to radians.
    double radX = RhinoMath.ToRadians(rotation.X);
    double radY = RhinoMath.ToRadians(rotation.Y);
    double radZ = RhinoMath.ToRadians(rotation.Z);

    // Create the rotation axis vectors
    Vector3d xAxis = new Vector3d(1, 0, 0);
    Vector3d yAxis = new Vector3d(0, 1, 0);
    Vector3d zAxis = new Vector3d(0, 0, 1);

    // Compute rotation around X, Y, and Z axes using the specified center.
    Transform rotX = Transform.Rotation(radX, xAxis, spawn);
    Transform rotY = Transform.Rotation(radY, yAxis, spawn);
    Transform rotZ = Transform.Rotation(radZ, zAxis, spawn);

    // Combine rotations.
    Transform combinedRot = rotY * (rotX * rotZ);

    A = combinedRot;
# ---------- end unityaction ----------
# Action
move = Move(Geometry=ln, Motion=vec2pt.Vector)  # -> Geometry, Transform
transform = Transform(Geometry=move.Geometry, Transform=unityaction)
record = RecordData(Data=transform, Record=True, Reset=reset, RecordFirstDataOnReset="True")
panel_13 = Panel(record)
rdlines = RemoveDuplicateLinesKaramba3D(Line=record, LimitDistance=0.005)  # -> OutLine, Info, Indexes
crv = Curve(rdlines.OutLine)
c_script_2 = CSharpScript(export=export, crvs=crv, path=path)  # -> A; inputs export: Boolean, crvs: list of Curve, path: String
# ---------- c_script_2: C# usings ----------
using System.IO;
# ---------- c_script_2: C# ----------
    List<string> messages = new List<string>();

    if (export && crvs != null && crvs.Count > 0)
    {
      if (string.IsNullOrEmpty(path))
      {
        messages.Add("Error: The path is null or empty.");
      }
      else
      {
        string directory = Path.GetDirectoryName(path);

        if (!Directory.Exists(directory))
        {
          Directory.CreateDirectory(directory);
        }

        string filepath = path;

        List<Guid> curveGuids = new List<Guid>();
        foreach (Curve crv in crvs)
        {
          if (crv != null)
          {
            Guid curveGuid = Rhino.RhinoDoc.ActiveDoc.Objects.AddCurve(crv);
            if (curveGuid != Guid.Empty)
            {
              curveGuids.Add(curveGuid);
              Rhino.RhinoDoc.ActiveDoc.Objects.Select(curveGuid);
            }
            else
            {
              messages.Add("Error: Failed to add a curve to the document.");
            }
          }
          else
          {
            messages.Add("Error: One of the input curves is null.");
          }
        }

        if (curveGuids.Count > 0)
        {
          string cmd = "_-Export " + "\"" + filepath + "\"" + " _Enter _Enter";
          bool result = Rhino.RhinoApp.RunScript(cmd, false);
          if (result)
          {
            messages.Add("Success: " + curveGuids.Count + " curves exported to " + filepath);
          }
          else
          {
            messages.Add("Error: Export failed.");
          }

          foreach (Guid curveGuid in curveGuids)
          {
            Rhino.RhinoDoc.ActiveDoc.Objects.Delete(curveGuid, true);
          }

          Rhino.RhinoDoc.ActiveDoc.Objects.UnselectAll();
        }
        else
        {
          messages.Add("Error: No valid curves provided for export.");
        }
      }
    }
    else if (crvs == null || crvs.Count == 0)
    {
      messages.Add("Error: No curves provided.");
    }

    A = messages;
# ---------- end c_script_2 ----------
panel_14 = Panel(c_script_2)

# ---- group: candidate
listseg = ListSegment(List=crv, Number=1, Mode="First/Last")  # -> FirstNItems, MiddleItems, LastNItems
curvepoint = PointOnCurve([listseg.MiddleItems, listseg.LastNItems], parameter=0.5)
curvepoint_2 = PointOnCurve(listseg.FirstNItems, parameter=0.5)
cp = ClosestPoint(Point=curvepoint, Cloud=curvepoint_2)  # -> ClosestPoint, CPIndex, Distance
python_2 = GhPythonScript(crv=crv, distance=cp.Distance, max_num=Slider(4, range=0..10))  # -> closest_crv, ind; inputs crv: list, distance: list, max_num: Int32
# ---------- python_2: Python ----------
import rhinoscriptsyntax as rs
def smallest_indices(nums):
    # Ensure we're working with a list of numbers
    if not all(isinstance(x, (int, float)) for x in nums):
        raise ValueError("The list contains non-numeric values")
    
    # Get the indices of the numbers sorted by their values
    sorted_indices = sorted(range(len(nums)), key=lambda k: nums[k])
    
    # Return the indices up to a maximum of 5
    return sorted_indices[:min(5, len(nums))]

if len(distance) < max_num:
    closest_crv = crv
else:
    results = smallest_indices(distance)
    
    closest_crv = []
    for result in results:
        result_crv = crv[result]
        closest_crv.append(result_crv)
# ---------- end python_2 ----------
panel_15 = Panel(crv)
end = EndPoints(Curve=python_2.closest_crv)  # -> Start, End
merge = Merge(Data1=end.Start, Data2=end.End)
culldup = CullDuplicates(Data=merge)
pt_3 = Point(culldup)

# ----
item_3 = ListItem(List=crv, Index=0, Wrap=True)
end_2 = EndPoints(Curve=crv)  # -> Start, End
meshpipe = MeshPipe(Curve=crv, Radius=Slider(0.1, range=0..0.1), Sides=Slider(3, range=0..10), Tolerance=10, Ending=Slider(3, range=0..10))
# Mass Aggregate
line2mesh = CSharpScript(lines=crv)  # -> mesh; inputs lines: list of Line
# ---------- line2mesh: C# ----------
    Mesh m = new Mesh();

    foreach (var line in lines)
    {
      // For each line, we'll add two vertices (start and end)
      m.Vertices.Add(line.From);
      m.Vertices.Add(line.To);

      // Create a quad face from these two vertices.
      // The face references the vertex indices.
      // Since we're adding the vertices sequentially, we can deduce their indices.
      int vertexCount = m.Vertices.Count;
      m.Faces.AddFace(vertexCount - 2, vertexCount - 1, vertexCount - 1, vertexCount - 2);
    }

    mesh = m;
# ---------- end line2mesh ----------
culldup_2 = CullDuplicates(Data=[end_2.End, end_2.Start])
merge_2 = Merge(Data1=crv, Data2=item_3)
mjoin = MeshJoin(Meshes=meshpipe)
conndir = Wasp_ConnectionFromDirection(GEO=mjoin, CEN=culldup_2, UP=merge_2)  # -> CONN, PLN_OUT; inputs CEN: list of Point3d, UP: list of Curve, T: list; plug-in component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
part = Wasp_BasicPart(NAME="test", GEO=line2mesh, CONN=flatten(conndir.CONN), COLL=mjoin)  # -> PART; inputs GEO: Mesh, CONN: list, ATTR: list; plug-in component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
item_4 = ListItem(List=pt_3, Index=Slider(2, range=0..2), Wrap=True)
item_5 = ListItem(List=pt_3, Index=0, Wrap=True)  # -> Item, Item1
candidates = RemoteSender(pt_3)
spawn_2 = RemoteReceiver(spawn)
pt_4 = Point(item_5.Item1)
number_slider_4 = Slider(30, range=0..100)
cp_2 = ClosestPoint(Point=candidates, Cloud=spawn_2)  # -> ClosestPoint, CPIndex, Distance
panel_16 = Panel(pt_3)
rulegen = Wasp_RulesGenerator(PART=part)  # -> R; inputs PART: list, SELF_P: Boolean, SELF_C: Boolean, TYP: Boolean, GR: list; plug-in component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
near_distance = RemoteSender(cp_2.Distance)
# Candidate Searching
stochasticaggregation = Wasp_StochasticAggregation(PART=flatten(part), N=number_slider_4, RULES=rulegen, SEED=Slider(100, range=0..1000), RESET=Toggle(True))  # -> AGGR, PART_OUT; inputs PART: list, PREV: list, N: Int32, RULES: list, SEED: Int32, MODE: Int32, GC: list, RESET: Boolean; plug-in component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
partgeo = Wasp_GetPartGeometry(PART=stochasticaggregation.PART_OUT)  # -> GEO; plug-in component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
cullnull = CullNull(InputList=partgeo)

# ---- group: Aggregate Amount
lng_3 = ListLength(List=cullnull)
subtraction = Subtraction(A=number_slider_4, B=lng_3)
python_3 = GhPythonScript(value=subtraction, orig=number_slider_4, weight=Slider(0.1, range=0..1))  # -> score
# ---------- python_3: Python ----------
import rhinoscriptsyntax as rs

if orig == value:
    score = 0
else:
    score = weight * -value
# ---------- end python_3 ----------

# ----
meshedges = MeshEdges(Mesh=partgeo)  # -> flatten(AllE), NakedE
agg_difference = RemoteSender(subtraction)

# ---- group: Volume Density
bbox = BoundingBox(Content=meshedges.AllE, Plane=PlaneXY(0, 0, 0), UnionBox=True)  # -> Box, Box_2
volume = Volume(Geometry=bbox.Box)  # -> Volume, Centroid
division = Division(A=number_slider_4, B=volume.Volume)
dom = ConstructDomain(DomainStart=Slider(0.004, range=0..0.01), DomainEnd=Slider(0.008, range=0..0.01))
score_gaussian = GhPythonScript(value=division, threashold=dom, weight=Slider(14, range=0..1000))  # -> score
# ---------- score_gaussian: Python ----------
import rhinoscriptsyntax as rs
import math

def gaussian_score(x, mean, sigma):
    """Calculate Gaussian function value for given x, mean, and sigma."""
    return math.exp(-((x-mean)**2) / (2 * sigma**2))

# Your given parameters
if not value:
    den_scr = -100
else:
    # Calculate mean and sigma based on your threshold values
    mean = (threashold[0] + threashold[1]) / 2.0
    sigma = (threashold[1] - threashold[0]) / 2.0  # This can be adjusted for how spread out you want the curve to be
    
    score = gaussian_score(value, mean, sigma)
    score = score * weight
# ---------- end score_gaussian ----------
panel_17 = Panel(score_gaussian)

# ----
number_slider_5 = Slider(0.00643, range=0..0.01)
# Evaluation
density = RemoteSender(division)
neg = Negative(Value=Slider(0.1, range=0..0.1))
neg_2 = Negative(Value=Slider(0.1, range=0..0.1))
element_count = Panel("5")
bbox_2 = BoundingBox(Content=transform, Plane=PlaneXY(0, 0, 0))  # -> Box, Box_2
addition = Addition(A=element_count, B=1)
debox = DeconstructBox(Box=bbox_2.Box)  # -> Plane, X, Y, Z
candidates_2 = RemoteReceiver(candidates)
num = Number(debox.X)
num_2 = Number(debox.Y)
num_3 = Number(debox.Z)
agg_difference_2 = RemoteReceiver(agg_difference)
near_distance_2 = RemoteReceiver(near_distance)
density_2 = RemoteReceiver(density)
rejson = SerializeJson(X=num, Y=num_2, Z=num_3, IncludeNullAndEmptyProperties=False)
pad = GhPythonScript(x=near_distance_2, amt=addition)  # -> a; inputs x: list, amt: Int32
# ---------- pad: Python ----------
import rhinoscriptsyntax as rs

def fill_list(vals, amt):
    # Replace None values, non-numeric values with 0
    for i, val in enumerate(vals):
        if val is None or not isinstance(val, (int, float)):
            vals[i] = 0
    # Calculate the number of zeros needed
    num_zeros = amt - len(vals)
    
    # Append the required number of zeros to x
    vals.extend([float(0)] * num_zeros)
    
    return vals

ls = fill_list(x, amt)
a = ls[-amt:] # select last amt element
# ---------- end pad ----------
pad_map = GhPythonScript(x=candidates_2, amt=addition)  # -> a; inputs x: list of Point3d, amt: Int32
# ---------- pad_map: Python ----------
import rhinoscriptsyntax as rs
import Rhino.Geometry as rg

def fill_points(x, amt):
    # Iterate over the list and check if each item is a valid Point3d
    for i, val in enumerate(x):
        if not isinstance(val, rg.Point3d):
            x[i] = 0  # replace invalid entries with zero
        else: x[i] = 1

    # Calculate the number of origin points needed
    num_origin_points = amt - len(x)
    
    # Append the required number of origin points to x
    for _ in range(num_origin_points):
        x.append(0)
    
    return x

a = fill_points(x, amt)
# ---------- end pad_map ----------
pad_pt = GhPythonScript(x=candidates_2, amt=addition)  # -> a; inputs x: list of Point3d, amt: Int32
# ---------- pad_pt: Python ----------
import rhinoscriptsyntax as rs
import Rhino.Geometry as rg

def fill_points(x, amt):
    # Iterate over the list and check if each item is a valid Point3d
    for i, val in enumerate(x):
        if not isinstance(val, rg.Point3d):
            x[i] = rg.Point3d(0, 0, 0)  # replace invalid entries with origin point

    # Calculate the number of origin points needed
    num_origin_points = amt - len(x)
    if not x:
        for _ in range(num_origin_points):
            x.append(rg.Point3d(0, 0, 0))
    else:
        # Append the required number of origin points to x
        for _ in range(num_origin_points):
            x.append(x[-1])
    
    return x

a = fill_points(x, amt)
# ---------- end pad_pt ----------
py = GhPythonScript(x=density_2)  # -> a
# ---------- py: Python ----------
import rhinoscriptsyntax as rs
if not x or x == None:
    a = 0
else:
    a = x
# ---------- end py ----------
panel_18 = Panel("sdfdsfsd")

crv_2 = Curve(meshedges.AllE)
license = LicenseKaramba3D()
panel_19 = Panel(license)
linetobeam = LineToBeamKaramba3D(
    Line=crv_2,
    New=True,
    Remove=True,
    LimitDistance_m=0.005,
    Bending=True,
    SetBucklingLength=True,
    ToPolylineMaxAngle=0.03,
    ToPolylineTolerance=0.01,
    ToPolylineMaxEdgeLength=0.25)  # -> Element, Points, Info
number_slider_6 = Slider(0.3, range=0..1)
mcx = MultipleCurves(Curves=crv_2)  # -> Points, IndexA, IndexB, ParamA, ParamB
number_slider_7 = Slider(0.3, range=0..1)
number_slider_8 = Slider(0.3, range=0..1)
number_slider_9 = Slider(75, range=0..100)
culldup_3 = CullDuplicates(Data=mcx.Points)
Z = UnitZ(Factor="-30")
pt_5 = Point(culldup_3)
loads = LoadsKaramba3D(Vector=Z, LCase="0", mode="Gravity")
supp = SupportKaramba3D(PosInd=pt_5, menu=[buttons(on, on, on, on, on, on)])
cross_section = CrossSectionKaramba3D(
    FamilyNameOfCrossSection="RHS",
    NameOfCrossSection="75X50X3",
    Height_cm=Slider(10, range=0..10),
    UpperFlangeWidth_cm=10,
    LowerFlangeWidth_cm=10,
    UpperFlangeThickness_cm=0.8,
    LowerFlangeThickness_cm=0.8,
    WebThickness_cm=0.5,
    FilletRadius_cm=0,
    mode="I")
cross_section_2 = CrossSectionKaramba3D(
    FamilyNameOfCrossSection="RHS",
    NameOfCrossSection="75X50X3",
    Height_cm=Slider(7.5, range=0..10),
    UpperFlangeWidth_cm=5,
    LowerFlangeWidth_cm=5,
    UpperFlangeThickness_cm=number_slider_6,
    LowerFlangeThickness_cm=number_slider_6,
    SidewallsThickness_cm=number_slider_6,
    FilletRadius_cm=Slider(0.3, range=0..1),
    mode="Box")
matselect = MaterialSelectionKaramba3D(NameOrListIndexOfMaterial="S235", menu=[dropdown(1), dropdown(1)])
panel_20 = Panel(cross_section)
panel_21 = Panel(cross_section_2)
assemble = AssembleModelKaramba3D(
    Point=pt_5,
    Elem=linetobeam.Element,
    Support=supp,
    Load=loads,
    CrossSection=cross_section,
    Material=matselect,
    LimitDistance_m=0.005)  # -> Model, Info, Mass_kg, CenterOfGravity, LoadCaseNames
model = ModelKaramba3D(assemble.Model)

# ---- group: Linearity
sort_pt = SortPoints(Points=pt_5)  # -> Points, Indices
intcrv = Interpolate(Vertices=sort_pt.Points, Degree=3, Periodic=False, KnotStyle=1)  # -> Curve, Length, Domain
item_6 = ListItem(List=sort_pt.Points, Index=0, Wrap=True)  # -> Item1, Item
ln_2 = Line(StartPoint=item_6.Item1, EndPoint=item_6.Item)
linearity = GhPythonScript(x=ln_2, y=intcrv.Curve, weight=Slider(20, range=0..100))  # -> isLinear, score
# ---------- linearity: Python ----------
import rhinoscriptsyntax as rs
def isEqual(num1, num2, threshold=1e-5):
    return abs(num1 - num2) < threshold

if x is None or y is None:
    isLinear = False
    score = 0
else:
    if isEqual(x, y):
        isLinear = True
        score = -1 * weight
    else:
        isLinear = False
        score = 0
# ---------- end linearity ----------

# ----
islinear = RemoteSender(linearity.isLinear)
analyze = AnalyzeKaramba3D(Model=model)  # -> CalculatedModel, MaximumDisplacement_cm, ResultingForceOfGravity_kN, ElasticEnergyChange_kNm

modelview = ModelViewKaramba3D(Model=analyze.CalculatedModel, ResultFactors=1, ResultCase=-1)  # -> Model, DeformedMesh, DeformedAxes, DeformedModel
beamview = BeamViewKaramba3D(Model=modelview.Model)  # -> Model, MeshesOfRenderedBeams, DeformedBeamAxes, LegendColors, LegendTags
legend = Legend(Colour=beamview.LegendColors, Tags=beamview.LegendTags, LegendType=1)
mesh = Mesh(beamview.MeshesOfRenderedBeams)

beamview_2 = BeamViewKaramba3D(Model=modelview.Model)  # -> Model, MeshesOfRenderedBeams, DeformedBeamAxes, LegendColors, LegendTags
listseg_2 = ListSegment(List=beamview.LegendTags, Number=1, Mode="First/Last")  # -> FirstNItems, MiddleItems, LastNItems
listseg_3 = ListSegment(List=beamview_2.LegendTags, Number=1, Mode="First/Last")  # -> FirstNItems, MiddleItems, LastNItems
abs = Absolute(Value=listseg_2.MiddleItems)
abs_2 = Absolute(Value=listseg_3.MiddleItems)
extremums = MinMax(Number=abs)  # -> Minimum, Maximum
extremums_2 = MinMax(Number=abs_2)  # -> Minimum, Maximum
max_stress = RemoteSender(extremums.Maximum)
score_linear = GhPythonScript(value=extremums.Maximum, threashold=Slider(40, range=0..100), weight=neg)  # -> score
# ---------- score_linear: Python ----------
import rhinoscriptsyntax as rs
import rhinoscriptsyntax as rs
if not value:
    stress_scr = -100
if not threashold:
    threashold = 0
if not weight:
    weight = 1

if value == 0:
    score = 0
else:
    score = value - threashold
    score = score * weight
# ---------- end score_linear ----------
score_linear_2 = GhPythonScript(value=extremums_2.Maximum, threashold=Slider(40, range=0..100), weight=neg_2)  # -> score; same code as score_linear
max_displacement = RemoteSender(extremums_2.Maximum)
panel_22 = Panel(score_linear)
panel_23 = Panel(score_linear_2)
addition_2 = Addition(
    Density=score_gaussian,
    AggregateCount=python_3,
    Linearity=linearity.score,
    Max_stress=score_linear,
    Max_deflation=score_linear_2)
panel_24 = Panel(addition_2)
max_displacement_2 = RemoteReceiver(max_displacement)
max_stress_2 = RemoteReceiver(max_stress)
islinear_2 = RemoteReceiver(islinear)
rejson_2 = SerializeJson(
    BBox=rejson,
    AggregationDiff=agg_difference_2,
    Density=py,
    MaxStress=max_stress_2,
    MaxDisplacement=max_displacement_2,
    IsLinear=islinear_2,
    NearDistance=pad,
    CandidatesMap=pad_map,
    IncludeNullAndEmptyProperties=False)
now = CSharpScript(x=rejson_2)  # -> A
# ---------- now: C# ----------
    A = DateTime.Now.Ticks;
# ---------- end now ----------
rejson_3 = SerializeJson(Score=addition_2, Observation=rejson_2, Candidates=pad_pt, Timestamp=now, IncludeNullAndEmptyProperties=False)
panel_25 = Panel(rejson_3)
udp_2 = UDPSender(Port=6001, Pattern=0, Data=panel_25)
